# Grasshopper definition Rotate.gh (Grasshopper 1.0.7)
# plug-ins: RolyPoly

# ---- group: INPUTS
# Additional geometry you want to simulate along with robot
geo_additionalgeom_optional = Geometry(<brep referenced from the Rhino model>)

# Reference line from center of robot in forward direction
crv_robotdirectionline = Curve(<curve referenced from the Rhino model>)

# Type in whatever robot namespace your Create3 is using.
# "Dolores" is the name of my robot.
panel = Panel("Dolores")

# ---- group: DEFINE ROBOT
# This element creates the "robot"
# You should put it at the starting location,
# in the orientation that you expect to start with.
createrobot = CreateRobot(RobotDirectionLine=crv_robotdirectionline, RobotName=panel, AdditionalGeometryO=geo_additionalgeom_optional)  # -> Robot, DebugGeometry

# ----
# Here we define a simple "rotate" action
number_slider = Slider(180, range=0..1000)
createactionrotate = CreateActionRotate(RotateAngleDegrees=number_slider)

# ---- group: CREATE SEQUENCE OF ACTIONS
# This component takes a simple, ordered, list of actions,
# and makes a sequence of instructions.
# 
# Unlike some of our other examples
# it doesn't rely on a polycurve path.
actionstorobotsequence = ActionsToRobotSequence(Actions=createactionrotate, Robot=createrobot.Robot)  # -> RobotSequence, DebugActions

# ---- group: TEXT PROGRAM OUTPUT
# This component takes a bunch of sequences
# (possibly for multiple separate robots),
# and turns it into one program.
# You can copy / paste this program into a Ros2 Python project,
# based on our starting project.
robotsequencestoprogram = RobotSequencesToProgram(RobotSequences=actionstorobotsequence.RobotSequence)
panel_2 = Panel(robotsequencestoprogram)

# ---- group: TEXT PROGRAM VALIDATION / SIMULATION
# These tools take an existing text program,
# previously defined,
# and validates that it works as intended by
# providing you with a simulation in the viewport.
validaterobotprogram = ValidateRobotProgram(Program=robotsequencestoprogram, RobotList=createrobot.Robot)  # -> RobotFrames, DbgAllFramesGeometry
selectrobotframe = SelectRobotFrame(RobotFrames=validaterobotprogram.RobotFrames, AnimationPosition01=Slider(0, range=0..1))  # -> RobotGeometry, CurrentProgramMessage
