# Grasshopper definition MultipleRobots_2.gh (Grasshopper 1.0.7)
# plug-ins: RolyPoly

# ---- group: INPUTS
# Additional geometry you want to simulate along with robot
geo_additionalgeom_optional = Geometry(<brep referenced from the Rhino model>)

# Regular "nurbs curves" don't work here:
# You must generate joined curves with segments of either type "arc" or "line"
polycrvpath = Curve(<curve referenced from the Rhino model>)

# Reference line from center of robot in forward direction
crv_robotdirectionline = Curve(<curve referenced from the Rhino model>)

# Type in whatever robot namespace your Create3 is using.
# "Dolores" is the name of my robot.
panel = Panel("Dolores")

geo_additionalgeom_optional_2 = Geometry(<brep referenced from the Rhino model>)
panel_2 = Panel("Maeve")
polycrvpath_2 = Curve(<curve referenced from the Rhino model>)
crv_robotdirectionline_2 = Curve(<curve referenced from the Rhino model>)

# ---- group: DEFINE ROBOT
# This element creates the "robot"
# You should put it at the starting location,
# in the orientation that you expect to start with.
createrobot = CreateRobot(RobotDirectionLine=crv_robotdirectionline, RobotName=panel, AdditionalGeometryO=geo_additionalgeom_optional)  # -> Robot, DebugGeometry

# ----
createsegmentproperties = CreateSegmentProperties(SegmentIndex=Slider(3, range=0..10), IsDriveForwardsO=Toggle(False))

createsegmentproperties_2 = CreateSegmentProperties(SegmentIndex=Slider(3, range=0..10), IsDriveForwardsO=Toggle(False))

# ---- group: DEFINE ROBOT
createrobot_2 = CreateRobot(RobotDirectionLine=crv_robotdirectionline_2, RobotName=panel_2, AdditionalGeometryO=geo_additionalgeom_optional_2)  # -> Robot, DebugGeometry

# ---- group: CREATE SEQUENCE OF ACTIONS
# This component takes a polycurve input and robot,
# and makes a sequence of instructions.
# Further properties can be specified (see other examples)
polycurvetorobotsequence = PolycurveToRobotSequence(PolycurvePath=polycrvpath, Robot=createrobot.Robot, SegmentPropertiesO=createsegmentproperties)  # -> RobotSequence, DebugActions

polycurvetorobotsequence_2 = PolycurveToRobotSequence(PolycurvePath=polycrvpath_2, Robot=createrobot_2.Robot, SegmentPropertiesO=createsegmentproperties_2)  # -> RobotSequence, DebugActions

# ---- group: TEXT PROGRAM OUTPUT
# This component takes a bunch of sequences
# (possibly for multiple separate robots),
# and turns it into one program.
# You can copy / paste this program into a Ros2 Python project,
# based on our starting project.
# IMPORTANT:
# 
# AS NOTED ELSEWHERE ON THIS SCRIPT...
# 
# Each robot has a "sequence" consisting of a certain number of "steps"
# 
# Within the paradigm we have defined, all sequences must have the same length.
# 
# This is how we make sure the robots stay synchronized.
# This prevents one robot from getting far ahead of all the others if it has fewer steps.
robotsequencestoprogram = RobotSequencesToProgram(RobotSequences=[polycurvetorobotsequence.RobotSequence, polycurvetorobotsequence_2.RobotSequence])
panel_3 = Panel(robotsequencestoprogram)

# ---- group: TEXT PROGRAM VALIDATION / SIMULATION
# These tools take an existing text program,
# previously defined,
# and validates that it works as intended by
# providing you with a simulation in the viewport.
validaterobotprogram = ValidateRobotProgram(Program=robotsequencestoprogram, RobotList=[createrobot.Robot, createrobot_2.Robot])  # -> RobotFrames, DbgAllFramesGeometry
selectrobotframe = SelectRobotFrame(RobotFrames=validaterobotprogram.RobotFrames, AnimationPosition01=Slider(0, range=0..1))  # -> RobotGeometry, CurrentProgramMessage
