# Grasshopper definition chorus.gh (Grasshopper 1.0.7)
# plug-ins: RolyPoly

# ---- group: INPUTS
# Additional geometry you want to simulate along with robot
geo_additionalgeom_optional = Geometry(<brep referenced from the Rhino model>)

# Reference line from center of robot in forward direction
crv_robotdirectionline = Curve(<curve referenced from the Rhino model>)

# Type in whatever robot namespace your Create3 is using.
# "Dolores" is the name of my robot.
panel = Panel("Dolores")

# ----
geo_additionalgeom_optional_2 = Geometry(<brep referenced from the Rhino model>)
crv_robotdirectionline_2 = Curve(<curve referenced from the Rhino model>)

note_frequencies_hz = Panel("""440
494
523
587
659
699
784
880""")
note_durations_s = Panel("""1
1
1
1
1
1
1
1""")

# ---- group: DEFINE ROBOT
# This element creates the "robot"
# You should put it at the starting location,
# in the orientation that you expect to start with.
createrobot = CreateRobot(RobotDirectionLine=crv_robotdirectionline_2, RobotName="Maeve", AdditionalGeometryO=geo_additionalgeom_optional_2)  # -> Robot, DebugGeometry

# ----
rev = ReverseList(List=note_frequencies_hz)
rev_2 = ReverseList(List=note_durations_s)
merge = Merge(Data1=rev, Data2=note_frequencies_hz)
merge_2 = Merge(Data1=note_frequencies_hz, Data2=rev)
merge_3 = Merge(Data1=rev_2, Data2=note_durations_s)
merge_4 = Merge(Data1=note_durations_s, Data2=rev_2)

# ---- group: DEFINE ROBOT
# This element creates the "robot"
# You should put it at the starting location,
# in the orientation that you expect to start with.
createrobot_2 = CreateRobot(RobotDirectionLine=crv_robotdirectionline, RobotName=panel, AdditionalGeometryO=geo_additionalgeom_optional)  # -> Robot, DebugGeometry

# ----
# Here we define a simple "play song" action
# Each note in the song has a duration (seconds) and frequency (hertz)
# Define them in lists.
createactionplaysong = CreateActionPlaySong(NoteDurationsSeconds=merge_3, NoteFrequenciesHertz=merge)

# ----
# Here we define a simple "play song" action
# Each note in the song has a duration (seconds) and frequency (hertz)
# Define them in lists.
createactionplaysong_2 = CreateActionPlaySong(NoteDurationsSeconds=merge_4, NoteFrequenciesHertz=merge_2)

# ---- group: CREATE SEQUENCE OF ACTIONS
# This component takes a simple, ordered, list of actions,
# and makes a sequence of instructions.
# 
# Unlike some of our other examples
# it doesn't rely on a polycurve path.
actionstorobotsequence = ActionsToRobotSequence(Actions=createactionplaysong, Robot=createrobot.Robot)  # -> RobotSequence, DebugActions

# This component takes a simple, ordered, list of actions,
# and makes a sequence of instructions.
# 
# Unlike some of our other examples
# it doesn't rely on a polycurve path.
actionstorobotsequence_2 = ActionsToRobotSequence(Actions=createactionplaysong_2, Robot=createrobot_2.Robot)  # -> RobotSequence, DebugActions

# ---- group: TEXT PROGRAM OUTPUT
# This component takes a bunch of sequences
# (possibly for multiple separate robots),
# and turns it into one program.
# You can copy / paste this program into a Ros2 Python project,
# based on our starting project.
robotsequencestoprogram = RobotSequencesToProgram(RobotSequences=[actionstorobotsequence_2.RobotSequence, actionstorobotsequence.RobotSequence])
panel_2 = Panel(robotsequencestoprogram)

# ---- group: TEXT PROGRAM VALIDATION / SIMULATION
# These tools take an existing text program,
# previously defined,
# and validates that it works as intended by
# providing you with a simulation in the viewport.
validaterobotprogram = ValidateRobotProgram(Program=robotsequencestoprogram, RobotList=[createrobot_2.Robot, createrobot.Robot])  # -> RobotFrames, DbgAllFramesGeometry
selectrobotframe = SelectRobotFrame(RobotFrames=validaterobotprogram.RobotFrames, AnimationPosition01=Slider(0, range=0..1))  # -> RobotGeometry, CurrentProgramMessage
